# Dynamo graph FinishFloorsByRooms.dyn "01.2_FinishFloors by Rooms" (Dynamo 2.10.1.3976)

code_block = CodeBlock { Category.ByName("OST_Rooms"); }
all_elements_of_category = ElementsOfCategory(Category=code_block)
выберите_уровень_помещений = Levels("Уровень 1")  # graph input
code_block_2 = CodeBlock { "Уровень"; }
getParameterValueByName = Element.GetParameterValueByName(element=all_elements_of_category, parameterName=code_block_2)
code_block_3 = CodeBlock(a=выберите_уровень_помещений, b=getParameterValueByName) { a.Name == b; }
filterByBoolMask = List.FilterByBoolMask(list=all_elements_of_category, mask=code_block_3)
значение_параметра_для = StringInput("")  # "Значение параметра для пользовательской группировки"; graph input
параметр_для_пользовательской = StringInput("Отделка пола")  # "Параметр для пользовательской группировки помещений"; graph input
getParameterValueByName_2 = Element.GetParameterValueByName(element=filterByBoolMask.in, parameterName=параметр_для_пользовательской)
code_block_4 = CodeBlock(a=значение_параметра_для, b=getParameterValueByName_2) { a==b; }
filterByBoolMask_2 = List.FilterByBoolMask(list=filterByBoolMask.in, mask=code_block_4)
finishBoundary = Room.FinishBoundary(room=filterByBoolMask_2.in)
byJoinedCurves = PolyCurve.ByJoinedCurves(curves=finishBoundary)
выберите_тип_пола = FloorTypes("Типовой 150мм")  # graph input
byOutlineTypeAndLevel = Floor.ByOutlineTypeAndLevel(outline=byJoinedCurves, floorType=выберите_тип_пола, level=выберите_уровень_помещений)
code_block_5 = CodeBlock { "Смещение от уровня"; }
смещение_пола_от_уровня = DoubleInput(0)  # graph input
setParameterByName = Element.SetParameterByName(element=byOutlineTypeAndLevel, parameterName=code_block_5, value=смещение_пола_от_уровня)
