# Dynamo graph 01.1_NWC_BatchExport_v.2.1.dyn (Dynamo 2.0.4.12684)

# group: Ввод данных
журнал_моделей = Filename("..\..\..\..\..\..\Users\Илья Петров\Desktop\1.txt")  # graph input
file_from_path = FileObject(path=журнал_моделей)
readText = FileSystem.ReadText(file=file_from_path)
code_block = CodeBlock { "\n"; }
split = String.Split(str=readText, separater0=code_block)
путь_сохранения_nwc_файлов = Directory("C:\Users\Илья Петров\Desktop\test")  # graph input

ipb_nwc_export = Python(IN[0]=split, IN[1]=путь_сохранения_nwc_файлов)
# ---------- ipb_nwc_export.python (99 lines) ----------
import clr
clr.AddReference('RevitServices')
import RevitServices
from RevitServices.Persistence import DocumentManager as DM
from RevitServices.Transactions import TransactionManager as TM

clr.AddReference('RevitAPI')
import Autodesk.Revit.DB
from Autodesk.Revit.DB import NavisworksExportScope, View3D, FilteredElementCollector, Document, ModelPathUtils, OpenOptions, NavisworksExportOptions, NavisworksCoordinates, DetachFromCentralOption, WorksetConfiguration, WorksetConfigurationOption, WorksharingUtils, WorksetTable

import System
from System import TimeSpan

class TimeCounter:
	def __init__(self):
		self.time = System.Diagnostics.Stopwatch.StartNew()
		self.time.Start()
	def stop(self):
		self.time.Stop()
		return self.time.Elapsed

uiapp = DM.Instance.CurrentUIApplication
app = uiapp.Application
doc = DM.Instance.CurrentDBDocument

model_list = IN[0]
folder_to_export = IN[1]

def worksets_info(model_path):
	worksets_info = WorksharingUtils.GetUserWorksetInfo(model_path)
	ws_id = []
	ws_names = []
	for ws in worksets_info:
		if "связ" not in ws.Name.ToLower():
			ws_id.append(ws.Id)
			ws_names.append(ws.Name)
	return ws_id
	
def open_options_file(ws_id):
	#ws_open_config = WorksetConfiguration().Open(ws_id)
	ws_open_config = WorksetConfiguration(WorksetConfigurationOption.CloseAllWorksets)
	ws_open_config.Open(ws_id)
	open_options = OpenOptions()
	open_options.DetachFromCentralOption = DetachFromCentralOption.DetachAndPreserveWorksets
	open_options.AllowOpeningLocalByWrongUser = True
	open_options.SetOpenWorksetsConfiguration(ws_open_config)	
	return open_options

def nwc_export_options(nwc_view):
	nwc_export_options = NavisworksExportOptions()
	nwc_export_options.ExportScope = NavisworksExportScope.View
	nwc_export_options.ViewId = nwc_view[0].Id		
	nwc_export_options.ExportRoomGeometry = False
	nwc_export_options.ExportRoomAsAttribute = False		
	nwc_export_options.Coordinates = NavisworksCoordinates.Shared
	nwc_export_options.ExportLinks = False
	nwc_export_options.ExportParts = True
	nwc_export_options.ExportElementIds = True
	nwc_export_options.DivideFileIntoLevels = True
	nwc_export_options.ExportUrls = False
	nwc_export_options.FindMissingMaterials = False
	nwc_export_options.ConvertElementProperties = False
	return nwc_export_options

all_time_dic = {}
for model in model_list:
	time = TimeCounter()
	
	model_path = ModelPathUtils.ConvertUserVisiblePathToModelPath(model)	
	ws = worksets_info(model_path)
	op_opt = open_options_file(ws)
	doc = app.OpenDocumentFile(model_path,op_opt)
	
	views3d = [v for v in FilteredElementCollector(doc).OfClass(View3D) if not v.IsTemplate]
	nwc_view = [view for view in views3d if "navisworks" in view.Name.ToLower()]
	
	get_nwc = nwc_export_options(nwc_view)
	
	doc.Export(folder_to_export, doc.Title, get_nwc)
	doc.Close(False)
	
	t = time.stop()
	all_time_dic[model] = t

all_time_by_file = []
#all_time_by_file.append("File time")
for file, time in all_time_dic.items():
	if 'full_time_count' not in locals():
		full_time_count = time
		all_time_by_file.append((file, (time.Minutes, time.Seconds, time.Milliseconds)))
	else:
		full_time_count += time
		all_time_by_file.append((file, (time.Minutes, time.Seconds, time.Milliseconds)))

full_time = (("Minutes", "Seconds", "Milliseconds"), "Full time:", (full_time_count.Minutes, full_time_count.Seconds, full_time_count.Milliseconds))

OUT = full_time, all_time_by_file	

#OUT = 'success'
# ----------------------------------------

# group: Подготовка отчета: Общее время
now = DateTime.Now()
string_from_object = FromObject(obj=now)
firstItem = List.FirstItem(list=ipb_nwc_export)
code_block_2 = CodeBlock(a=firstItem) { a[1] + " " + a[2][0] + ":" + a[2][1] + ":" + a[2][2]; }
list_create = List.Create(item0=string_from_object, item1=code_block_2)

# group: Подготовка отчета: Декомпозиция по файлам
code_block_3 = CodeBlock { 1; 3; 1; }
slice = List.Slice(list=ipb_nwc_export, start=code_block_3.out0, end=code_block_3.out1, step=code_block_3.out2)
code_block_4 = CodeBlock { 0; 1; }
getItemAtIndex = List.GetItemAtIndex(list=slice@L3, index=code_block_4.out0)
getItemAtIndex_2 = List.GetItemAtIndex(list=slice@L3, index=code_block_4.out1)
string_from_object_2 = FromObject(obj=getItemAtIndex_2)
python_script = Python(IN[0]=string_from_object_2)
# ---------- python_script.python (7 lines) ----------
timelist = IN[0]
out_list = []
for f in timelist:
	file_time = "File time: " + f[0] + ":" + f[1] + ":" + f[2]
	out_list.append(file_time)
	
OUT = out_list
# ----------------------------------------
list_create_2 = List.Create(item0=getItemAtIndex, item1=python_script)
transpose = List.Transpose(lists=list_create_2)

# group: Запись отчета
файл_журнала = Filename("..\..\..\..\..\..\Users\Илья Петров\Desktop\2.txt")  # graph input
code_block_5 = CodeBlock { "\n"; }
list_create_3 = List.Create(item0=list_create, item1=transpose)
flatten = List.Flatten(list=list_create_3)
length = String.Length(str=flatten)
code_block_6 = CodeBlock { "\n"; }
insert = String.Insert(str=flatten, index=length, toInsert=code_block_6)
list_create_4 = List.Create(item0=code_block_5, item1=insert)
appendText = FileSystem.AppendText(filePath=файл_журнала, text=list_create_4)
