# Dynamo graph TransferModelToSHARED.dyn "model_to_sharedZone" (Dynamo 2.3.1.11775)

script = Python()  # "ipb_tech.script"; unwired: IN[0]
# ---------- script.python (30 lines) ----------
import clr
clr.AddReference('RevitAPI') # Основная библиотека Revit API
from Autodesk.Revit.DB import *

clr.AddReference("RevitServices")
from RevitServices.Persistence import DocumentManager as DM

doc = DM.Instance.CurrentDBDocument
path_doc = doc.PathName
bfi = BasicFileInfo.Extract(path_doc)


""" Через Username. Работает только на лицензионных версиях
if doc.IsWorkshared:
	username = bfi.Username
	z = path_doc.rfind("\\") + 1
	file_name = path_doc[z:len(path_doc)]
	file_name_edit = file_name.replace(("_" + username), "")
	file_path = path_doc[0:z]
	OUT = path_doc, file_name_edit
"""

if doc.IsWorkshared:
	z = bfi.CentralPath.rfind("\\") + 1
	file_name = bfi.CentralPath[z:len(bfi.CentralPath)]
	OUT =  bfi.CentralPath, file_name
else: 
	z = path_doc.rfind("\\") + 1
	file_name = path_doc[z:len(path_doc)]	
	OUT = path_doc, file_name
# ----------------------------------------
code_block = CodeBlock(a=script) { a[0]; a[1]; }
file_from_path = FileObject(path=code_block.out0)
путь_сохранения_текущего_файла = Directory("C:\Users\user\Desktop\RevitTestCopyGoal")  # graph input
code_block_2 = CodeBlock(a=путь_сохранения_текущего_файла, b=code_block.out1) { a+"\\"+b; }
code_block_3 = CodeBlock { true; }
copyFile = FileSystem.CopyFile(file=file_from_path, destinationPath=code_block_2, overwrite=code_block_3)

# group: Заглушка
directory_from_path = DirectoryObject(path=путь_сохранения_текущего_файла)  # frozen
getDirectoryContents = FileSystem.GetDirectoryContents(directory=directory_from_path)
today = DateTime.Today()  # frozen
